# Grasshopper definition A2.gh (Grasshopper 1.0.8)

# This changes the number
# size of the slot
number_slider = Slider(0.19, range=0..20)
rectangle = Rectangle(Plane=PlaneXY(0, 0, 0), XSize=number_slider, YSize=Slider(0.5, range=0..20), Radius=0)  # -> Rectangle, Length
number_slider_2 = Slider(6, range=0..10)
# This changes the number
# of sides on the polygon
number_slider_3 = Slider(2, range=0..20)
vector_xyz = VectorXYZ(XComponent=Slider(-0.089, range=-20..20), YComponent=Slider(1.281, range=-20..20), ZComponent=0)  # -> Vector, Length
move = Move(Geometry=rectangle.Rectangle, Motion=vector_xyz.Vector)  # -> Geometry, Transform
# This creates the polygon of N sides
polygon = Polygon(Plane=PlaneXY(0, 0, 0), Radius=number_slider_3, Segments=number_slider_2, FilletRadius=Slider(0, range=0..7))  # -> Polygon, Length
# This creates generates the same
# number of slots as sides in the polygon
arrpolar = PolarArray(Geometry=move.Geometry, Plane=PlaneXY(0, 0, 0), Count=number_slider_2, Angle=6.283185307)  # -> Geometry, Transform
# Bake this!
merge = Merge(Data1=polygon.Polygon, Data2=arrpolar.Geometry)
