# Grasshopper definition A2_autosave.gh (Grasshopper 1.0.8)

polygon = Polygon(
    Plane=PlaneXY(0, 0, 0),
    Radius=Slider(2, range=0..20),
    Segments=Slider(6, range=0..10),
    FilletRadius=Slider(0, range=0..7))  # -> Polygon, Length
rectangle = Rectangle(Plane=PlaneXY(0, 0, 0), XSize=Slider(0.519, range=0..20), YSize=Slider(1.294, range=0..20), Radius=0)  # -> Rectangle, Length
vector_xyz = VectorXYZ(XComponent=Slider(0, range=-20..20), YComponent=Slider(0.466, range=-20..20), ZComponent=0)  # -> Vector, Length
move = Move(Geometry=rectangle.Rectangle, Motion=vector_xyz.Vector)  # -> Geometry, Transform
